# Dynamo graph OXOX.dyn (Dynamo 2.6.1.8786)

# group: Get the O and X families
code_block = CodeBlock { ["X", "O"]; }
byName = FamilyType.ByName(name=code_block)
# note: X = list 0
# O = list 1
byFamilyType = FamilyInstance.ByFamilyType(familyType=byName)

code_block_2 = CodeBlock(FamType=byName) { FamType; }

# group: Make my board
code_block_3 = CodeBlock { 1500; }
byWidthLength = Rectangle.ByWidthLength(width=code_block_3, length=code_block_3)
code_block_4 = CodeBlock()
# ---------- code_block_4.designscript (3 lines) ----------
//squares 0, 1, 2;
[-1500, 0, 1500];
[-1500, 0, 1500];
# ----------------------------------------
translate = Geometry.Translate(geometry=byWidthLength, xTranslation=code_block_4.out0, yTranslation=code_block_4.out1, lacing=CrossProduct)

transpose = List.Transpose(lists=translate)

# group (continued): Make my board
# note: Game squares
flatten = List.Flatten(list=transpose)

code_block_5 = CodeBlock(GameSquares=flatten) { GameSquares; }
code_block_6 = CodeBlock(GameSquares=code_block_5) { GameSquares; }

# group: Tests for first move
code_block_7 = CodeBlock(i=byFamilyType) { i[0]; }
isEmpty = List.IsEmpty(list=code_block_7)

# group: User Input
square_choose_1 = Python(IN[0]=isEmpty)
# ---------- square_choose_1.python (38 lines) ----------
import clr
clr.AddReference('ProtoGeometry')
from Autodesk.DesignScript.Geometry import *

clr.AddReference('RevitAPI')
import Autodesk
from Autodesk.Revit.DB import *

clr.AddReference('RevitNodes')
import Revit
clr.ImportExtensions(Revit.GeometryConversion)

clr.AddReference('RevitAPIUI')
from Autodesk.Revit.UI import *
from Autodesk.Revit.UI.Selection import *

clr.AddReference('RevitServices')
import RevitServices
from RevitServices.Persistence import DocumentManager

doc = DocumentManager.Instance.CurrentDBDocument
uidoc = DocumentManager.Instance.CurrentUIApplication.ActiveUIDocument

#First move
if IN[0] == True:
	TaskDialog.Show("Info", "Pick your square then hit the escape key")

outPt = []
flag = True
while flag:
	try:
		pt = uidoc.Selection.PickPoint("Pick your square then hit the escape key")
		outPt.append(pt.ToPoint())
	except:
		flag = False
		break

OUT = outPt
# ----------------------------------------

# group: Check user has played on board
containmentTest = Polygon.ContainmentTest(polygon=code_block_6, point=square_choose_1, lacing=CrossProduct)
flatten_2 = List.Flatten(list=containmentTest)
python_script = Python(IN[0]=flatten_2)
# ---------- python_script.python (4 lines) ----------
for index, value in enumerate(IN[0]):
	if value == True:
		OUT = index
	
# ----------------------------------------

# group: Filter any O or X that is not on the board
# note: location of each X or O
location = FamilyInstance.Location(familyInstance=byFamilyType)
python_script_2 = Python(IN[0]=location)
# ---------- python_script_2.python (12 lines) ----------
# Load the Python Standard and DesignScript Libraries
import sys
import clr
clr.AddReference('ProtoGeometry')
from Autodesk.DesignScript.Geometry import *

clr.AddReference ('DSCoreNodes')
import DSCore
from DSCore import *

#Zips the lists
OUT = List.Flatten (zip (IN[0][0], IN[0][1]))
# ----------------------------------------
# note: The entire board
byGeometry = BoundingBox.ByGeometry(geom=flatten)
# note: Are these X or O on the board?
contains = BoundingBox.Contains(boundingBox=byGeometry, point=python_script_2)
# note: Keep family instance and locations
# if they're on the board
filterByBoolMask = List.FilterByBoolMask(list=python_script_2, mask=contains)

# group: Current O and X locations
containmentTest_2 = Polygon.ContainmentTest(polygon=code_block_5, point=filterByBoolMask.in, lacing=CrossProduct)
# note: bool list of taken squares
transpose_2 = List.Transpose(lists=containmentTest_2)
flatten_3 = List.Flatten()  # unwired: list
# note: Create all false list if board is empty
map = List.Map(list=transpose_2, f_x=flatten_3)
python_script_3 = Python(IN[0]=map)
# ---------- python_script_3.python (4 lines) ----------
if IN[0][0] == None: 
	OUT = [[False, False, False, False, False, False, False, False, False]]
else:
	OUT = IN[0]
# ----------------------------------------

# group: CODE
# note: Main game code
python_script_4 = Python(IN[0]=python_script_3, IN[1]=python_script)
# ---------- python_script_4.python (167 lines) ----------
import random,  sys, copy

class XNOComputer (object):
    weight = [.5,.3,.5,
            .3,.4,.3,
            .5,.3,.5]
    depth = 10

    def __init__(self, board, wins, turn):
        self.board = board
        self.wins = wins
        self.turn = turn
        self.reset_test_board()
        self.reset_test_turn()

    def get_move(self):
        next_move = []
        weight = 0

        for our_move_key, our_move_val in enumerate(self.testboard):
            if our_move_val != False:
                continue

            for their_move_key, their_move_val in enumerate(self.testboard):
                if their_move_val != False:
                    continue

                self.reset_test_turn()
                self.reset_test_board()

                if self.check_make_move(our_move_key):
                    return our_move_key
                if self.check_make_move(their_move_key):
                    return their_move_key

                self.reset_test_turn()
                self.reset_test_board()

                if self.check_make_move(their_move_key):
                    return their_move_key
                if self.check_make_move(our_move_key):
                    return our_move_key

            current_weight = self.weight[our_move_key]
            if current_weight > weight:
                next_move = [our_move_key]
                weight = current_weight
            elif current_weight == weight:
                next_move.append(our_move_key)

        return next_move[random.randrange(len(next_move))]

    def check_make_move(self, key):
        if self.testturn % 2 == 0:
            self.testboard[key] = 'X'
        else:
            self.testboard[key] = 'O'

        self.testturn += 1

        if self.check_win():
            return True

        return False

    def check_win(self):
        for possible_pos in range(len(self.wins)): # loop all possible win combos
            possible_winner = ''
            for pos in range(len(self.wins[possible_pos])): # loop current win positions
                current = self.testboard[self.wins[possible_pos][pos]] # get current board value from this possible win position
                if current == False: # ignore if not x or o
                    break
                if not pos: # store x or o if this is the start of the current check and skip
                    possible_winner = current
                    continue
                if possible_winner != current: # if position value differs, no win given
                    break
                if (pos == 2 and possible_winner == current): # if all positions in win combo match then a win is given
                    return possible_winner
        return False # otherwise False is given

    def reset_test_board(self):
        self.testboard = copy.deepcopy(self.board)

    def reset_test_turn(self):
        self.testturn = copy.deepcopy(self.turn)

moose = [ ] 
wins = [ # possible win combos
	range(0, 2 + 1), # rows
	range(3, 5 + 1),
	range(6, 8 + 1),
	range(0, 6 + 1, 3), # cols
	range(1, 7 + 1, 3),
	range(2, 8 + 1, 3),
	range(0, 8 + 1, 4), # diags
	range(2, 6 + 1, 2),
]

def check_win():
	for possible_pos in range(len(wins)): # loop all possible win combos
		possible_winner = ''
		for pos in range(len(wins[possible_pos])): # loop current win positions
			current = board[wins[possible_pos][pos]] # get current board value from this possible win position
			if current == False: # ignore if not x or o
				break
			if not pos: # store x or o if this is the start of the current check and skip
				possible_winner = current
				continue
			if possible_winner != current: # if position value differs, no win given
				break
			if (pos == 2 and possible_winner == current): # if all positions in win combo match then a win is given
				return possible_winner
	return False # otherwise False is given

def get_computer_move():
	possible_moves = []
	for index, value in enumerate(board):
		if value is not False:
		    continue
		possible_moves.append(index)
	computer_move = possible_moves[random.randrange(len(possible_moves))]
	board[computer_move] = "O"
	return computer_move  		

try: 
	moves = IN[0]
	turn = len(moves)
except:
	moves = [[False*9]]
	turn = len(moves)

board = [False for pos in range(9)]

for move_index, move_location_array in enumerate(moves):
	for move_location_index, has_move in enumerate(move_location_array):
		
		if has_move == False:
			continue
		
		if move_index % 2 == 0:
			fam = "X"
		else:
			fam = "O"		
			
		board[move_location_index] = fam

board[IN[1]] = "X"

winner = check_win()
computer_move = False

if winner:
	moose.append(winner + ' is the winner!')
elif turn == 8:
	moose.append('Draw!')
else:
	board_copy = copy.deepcopy(board)
	turn_copy = copy.deepcopy(turn)
	computed = XNOComputer(board_copy, wins, turn_copy)
	computer_move = computed.get_move()
	board[computer_move] = 'O'
	winner = check_win()
	if winner:
		moose.append(winner + ' is the winner!')

OUT = computer_move, moose
# ----------------------------------------

# group: XO locations and families
code_block_8 = CodeBlock(FamType=code_block_2) { FamType; }
# note: Get the Human and PC's moves
code_block_9 = CodeBlock(i=code_block_6, Hu=python_script, Py=python_script_4) { [i[Hu],i[Py[0]]]; }
# note: Centre points of chosen rectangles
center = Polygon.Center(polygon=code_block_9)

# group: Output to Revit
byPoint = FamilyInstance.ByPoint(familyType=code_block_8, point=center)

# group: End of game pop up
code_block_10 = CodeBlock(i=python_script_4) { i[1][0]; }
python_script_5 = Python(IN[0]=code_block_10)
# ---------- python_script_5.python (39 lines) ----------
import clr
clr.AddReference('RevitAPIUI')
from Autodesk.Revit.UI import TaskDialog, TaskDialogCommonButtons, TaskDialogResult, TaskDialogCommandLinkId, TaskDialogIcon

Message = "Thanks for playing this game"
Main = IN[0]
test = [] 

for item in Main:
	test.append(1)

if "winner!" in Main:
	header = "Winner!"
elif "Draw" in Main:
	header = "Draw"
else:
	header = "ERROR"

if Message != None:
	run_me = True

mainDialog = TaskDialog(header)
mainDialog.MainInstruction = Main
mainDialog.MainContent = Message

if run_me == True:
	type =TaskDialogIcon.TaskDialogIconInformation
	mainDialog.MainIcon = type


	mainDialog.CommonButtons = TaskDialogCommonButtons.Yes;
	mainDialog.DefaultButton = TaskDialogResult.Yes;

	mainDialog.FooterText = "<a href=\"https://github.com/lukeroot\">" +"Luke Root and MoosiestMoose hope you enjoyed our game </a>";

	tResult = mainDialog.Show()
	OUT = tResult, "Pop-up Generated", False
else:
	OUT = "","No pop-up Generated", True
# ----------------------------------------
